# Dynamo graph upload_geometry.dyn (Dynamo 2.10.1.3976)

# group: unload geometry space
directory_path_for_gbxml_file = Directory("C:\Users\vikto\works")  # graph input
name_of_gbxml_file = StringInput("test.xml")  # graph input
python_script = Python(IN[0]=directory_path_for_gbxml_file, IN[1]=name_of_gbxml_file)  # IronPython2
# ---------- python_script.python (31 lines) ----------
# Load the Python Standard and DesignScript Libraries
import sys
import clr
clr.AddReference('ProtoGeometry')
from Autodesk.DesignScript.Geometry import *
# Import RevitAPI
clr.AddReference("RevitAPI")
import Autodesk
from Autodesk.Revit.DB import *
# Import DocumentManager and TransactionManager
clr.AddReference("RevitServices")
import RevitServices
from RevitServices.Persistence import DocumentManager
from RevitServices.Transactions import TransactionManager


# Standard areas for Current Document, Active UI and application
doc = DocumentManager.Instance.CurrentDBDocument


outputDirectory = IN[0]
outputFileName = IN[1]
gbxmlOpts = GBXMLExportOptions()

TransactionManager.Instance.EnsureInTransaction(doc)

doc.Export(outputDirectory, outputFileName, gbxmlOpts)

#The following method will close the transaction and confirm any changes
#made to the Revit document's database.
TransactionManager.Instance.TransactionTaskDone()
# ----------------------------------------

select_model_elements = DSModelElementsSelection()  # 16 picked in the model; graph input
getCategory = Element.GetCategory(element=select_model_elements)
string_from_object = FromObject(object=getCategory)
exclude_categories = CodeBlock()
# ---------- exclude_categories.designscript (12 lines) ----------
[
"Site - Survey Point",
"Site - Project Base Point",
"Views",
"Elevations",
"Levels",
"Reference Planes",
"Dimensions",
"Section Boxes",
"Walls",
"Floors"
];
# ----------------------------------------
python_script_2 = Python(IN[0]=string_from_object, IN[1]=exclude_categories)  # IronPython2
# ---------- python_script_2.python (1 lines) ----------
OUT = [False if cat in IN[1] else True for cat in IN[0]]
# ----------------------------------------
filterByBoolMask = List.FilterByBoolMask(list=select_model_elements, mask=python_script_2)
python_script_3 = Python(IN[0]=filterByBoolMask.in)  # IronPython2
# ---------- python_script_3.python (8 lines) ----------
start_point_elems = []
end_point_elems = []

for elem in IN[0]:
	start_point_elems.append(elem.BoundingBox.MinPoint)
	end_point_elems.append(elem.BoundingBox.MaxPoint)

OUT = start_point_elems, end_point_elems
# ----------------------------------------
code_block = CodeBlock(points=python_script_3) { points[0]; points[1]; }
byStartPointEndPoint = Line.ByStartPointEndPoint(startPoint=code_block.out0, endPoint=code_block.out1)
identity = CoordinateSystem.Identity()

# group: moves the element location point to survey point coordinate system
surveyPoint = Coordinates.SurveyPoint()
byOrigin = CoordinateSystem.ByOrigin(origin=surveyPoint)
transform = Geometry.Transform(geometry=byStartPointEndPoint, fromCoordinateSystem=byOrigin, contextCoordinateSystem=identity)

boundingBox = Geometry.BoundingBox(geometry=transform)
flatten = List.Flatten(list=boundingBox)
python_script_4 = Python(IN[0]=filterByBoolMask.in, IN[1]=flatten)  # IronPython2
# ---------- python_script_4.python (4 lines) ----------
elems_name = [[elem.Name] for elem in IN[0]]
elems_geometry = [[geom.MinPoint.X, geom.MinPoint.Y, geom.MinPoint.Z, geom.MaxPoint.X, geom.MaxPoint.Y, geom.MaxPoint.Z] for geom in IN[1]]

OUT = [["Name", "MinX", "MinY", "MinZ", "MaxX", "MaxY", "MaxZ"]] + [name + geom for name, geom in zip(elems_name, elems_geometry)]
# ----------------------------------------

# group: unload elements geometry
directory_path_for_csv_file = Directory("C:\Users\vikto\works")  # graph input
name_of_csv_file = StringInput("test.csv")  # graph input
code_block_2 = CodeBlock(directory=directory_path_for_csv_file, filename=name_of_csv_file) { directory; filename; directory + '\' + filename; }
exportCSV = Data.ExportCSV(filePath=code_block_2.out2, data=python_script_4)

basePoint = Coordinates.BasePoint()
byOrigin_2 = CoordinateSystem.ByOrigin(origin=basePoint)
boundingBox_2 = Element.BoundingBox(element=filterByBoolMask.in)
watch = Watch(code_block.out1)
